# Grasshopper definition Bitimage.gh (Grasshopper 1.0.7)
# plug-ins: MeshEdit Components

mesh = Mesh([<mesh referenced from the Rhino model> x210])
area = MeshArea(Mesh=mesh)  # -> Area, Centroid
pdecon = Deconstruct(Point=area.Centroid)  # -> XComponent, YComponent, ZComponent
sort = SortList(Keys=pdecon.XComponent, ValuesA=mesh)  # -> Keys, ValuesA
partition = PartitionList(List=sort.ValuesA, Size=Slider(3, range=0..10))  # -> simplify(Chunks)
area_2 = MeshArea(Mesh=partition)  # -> Area, Centroid
pdecon_2 = Deconstruct(Point=area_2.Centroid)  # -> XComponent, YComponent, ZComponent
number_slider = Slider(0, range=0..10)
sort_2 = SortList(Keys=pdecon_2.YComponent, ValuesA=partition)  # -> Keys, reverse(flatten(ValuesA))
number_slider_2 = Slider(0, range=0..210)
item = ListItem(List=sort_2.ValuesA, Index=number_slider_2, Wrap=True)
fly = Ladybug_fly(inputSliders=number_slider_2, fly=Button())  # -> Vviiiiiiiiiizzz; plug-in component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
rec = DataRecorder(number_slider_2, DataLimit=-10, RecordData=True)
mesh_2 = Mesh(<mesh referenced from the Rhino model>)
lng = ListLength(List=rec)
demesh = DeconstructMesh(Mesh=item)  # -> Vertices, Faces, Colours, Normals
partition_2 = PartitionList(List=demesh.Colours, Size=Slider(21, range=0..100))  # -> simplify(Chunks)
button = Button()
c_script = CSharpScript(path="C:\Users\kazuj\Documents\_IAMAS\認知の境界\印刷用紙片", name=number_slider_2, extension="png", colors=partition_2, write=lng)  # -> out, A; inputs path: String, name: String, extension: String, colors: tree of Color, write: Boolean
# ---------- c_script: C# usings ----------
using System.Drawing;
using System.IO;
# ---------- c_script: C# ----------
    if(!write) return;

    int height = colors.Branches[0].Count;
    int width = colors.BranchCount;


    string imagePath = Path.Combine(path, name) + "." + extension;
    Print(imagePath);

    var image = new Bitmap(width, height);

    for(int i = 0;i < width; i++)
    {
      for(int j = 0; j < height; j++)
      {
        image.SetPixel(i, j, colors.Branches[i][j]);
      }
    }

    switch(extension)
    {
      case "jpg":
        image.Save(imagePath, System.Drawing.Imaging.ImageFormat.Jpeg);
        break;
      case "png":
        image.Save(imagePath, System.Drawing.Imaging.ImageFormat.Png);
        break;
      default:
        Print("please select extension jpg or png");
        break;
    }
# ---------- end c_script ----------
panel = Panel(c_script.out)
