# Grasshopper definition ConvParam.gh (Grasshopper 1.0.7)
# plug-ins: MeshEdit Components, Chromodoris, Weaverbird, Kangaroo2 Components

series = Series(Start=0, Step=1, Count=Slider(14, range=0..100))
dom = ConstructDomain(DomainStart=0, DomainEnd=Slider(76, range=0..1000))
bnd = Bounds(Numbers=series)
remap = RemapNumbers(Value=series, Source=bnd, Target=dom)  # -> Mapped, Clipped
sin = Sine(Value=remap.Mapped)
multiplication = Multiplication(A=sin, B=Slider(5, range=0..10))
# 魔インニング
# 
# Brave
# StrageToken
number_slider = Slider(100, range=0..100)
box = CenterBox(Base=PlaneXY(0, 0, 0), X=1, Y=1, Z=1)
pt = ConstructPoint(XCoordinate=series, YCoordinate=multiplication, ZCoordinate=0)
divide = DivideCurve(Count=10, Kinks=False)  # -> Points, Tangents, Parameters
number_slider_2 = Slider(1, range=0..10)
pop3d = Populate3D(Region=box, Count=number_slider, Seed=1)
intcrv = Interpolate(Vertices=pt, Degree=3, Periodic=False, KnotStyle=1)  # -> Curve, Length, Domain
timer = Timer(TimerInterval=100, Target=c_script)  # disabled
dot = DotDisplay(Point=pop3d)
pipe = Pipe(Curve=intcrv.Curve, Radius=1, Caps=2)
wires = BrepWireframe(Brep=pipe, Density=-1)
python = GhPythonScript()  # -> out, a; inputs pts: tree of Vector3d, iterat: Int32, region: Brep; disabled
# ---------- python: Python ----------
__author__ = "kazuj"
__version__ = "2020.05.19"



import rhinoscriptsyntax as rs
import Rhino.Geometry as rg

def separation(ptList):
    rtn_list = []
    all_vector = [rg.Vector3d.Zero] * len(ptList)
    
    for i in range(len(ptList)):
        move_vec = rg.Vector3d.Zero
        count = 0
        for l in range(len(ptList)):
            dist = rs.VectorLength(ptList[i] - ptList[l])
            
            if dist < _distance:
                vec =  (ptList[i] - ptList[l])
                rs.VectorUnitize(vec)
                move_vec += vec
                count += 1
                
        if count != 0:
                move_vec /= count
        all_vector[i] = move_vec * _step
    
    for i in  range(len(ptList)):
        rtn_list.append(ptList[i] + all_vector[i])
    return rtn_list
    

for i in range(_iterat):
    _pts = separation(_pts)
    for l in range(len(_pts)):
        pt = rg.Point3d(_pts[l])
        if _region.IsPointInside(pt, 0.1, False):
            _pts[l] = rg.Vector3d(_region.ClosestPoint(pt))

a = _pts
# ---------- end python ----------
c_script = CSharpScript(positions=pop3d, distance=number_slider_2, step=Slider(0.6, range=0..1), region=pipe, reset=Button())  # -> out, A; inputs positions: list of Vector3d, distance: Double, step: Double, region: Brep, reset: Boolean
# ---------- c_script: C# ----------
    if(outPositions.Count != _positions.Count ||
      _reset == true)
    {
      outPositions = _positions;
    }

    var moveVectors = new List<Vector3d>();
    for(int i = 0; i < outPositions.Count; i++)
    {
      var move_vec = new Vector3d(0, 0, 0);
      var count = 0.0;

      for(int j = 0; j < outPositions.Count; j++)
      {
        double dist = (outPositions[i] - outPositions[j]).Length;
        if(dist < _distance)
        {
          move_vec += (outPositions[i] - outPositions[j]);
          count++;
        }
      }

      if(count == 0)
      {
        moveVectors.Add(new Vector3d(0, 0, 0));
        continue;
      }

      move_vec /= count;
      move_vec.Unitize();
      move_vec *= _step;
      
       moveVectors.Add(move_vec);
/*
      var testVec = outPositions[i] + move_vec;
      var pt = new Point3d(testVec);
      if(_region.IsPointInside(pt, 0.1, false))
      {
        moveVectors.Add(move_vec);
      }
      else
      {
        moveVectors.Add(new Vector3d(0, 0, 0));
      }
      */
    }


    for(int i = 0; i < outPositions.Count; i++)
    {
      outPositions[i] += moveVectors[i];

      var pt = new Point3d(outPositions[i]);
      if(_region.IsPointInside(pt, 0.1, false) == false)
      {
        outPositions[i] = new Vector3d(_region.ClosestPoint(pt));
      }

    }



    A = outPositions;
# ---------- c_script: C# additional code ----------
  List<Vector3d> outPositions = new List<Vector3d>();

  /// <summary>
  /// This method will be called once every solution, before any calls to RunScript.
  /// </summary>
  public override void BeforeRunScript()
  { }
  /// <summary>
  /// This method will be called once every solution, after any calls to RunScript.
  /// </summary>
  public override void AfterRunScript()
  { }
# ---------- end c_script ----------
pt_2 = Point(c_script.A)
del3d = _3DDelaunay(Points=pt_2)  # -> TopologicalEdges, Connectivity
voxelsample = SampleVoxels(
    Points=pt_2,
    Charges=number_slider_2,
    VoxelSize=number_slider_2,
    EffectiveRange=expr("x*2", number_slider_2),
    DensitySampling=False,
    LinearSampling=True)  # -> Box, VoxelData
number_slider_3 = Slider(100, range=0..100)
number_slider_4 = Slider(0, range=0..100)
len = Length(Curve=del3d.TopologicalEdges)
isosurface = BuildIsoSurface(Box=voxelsample.Box, VoxelData=voxelsample.VoxelData, SampleValue=number_slider_2)
bnd_2 = Bounds(Numbers=len)
wbloop = WeaverbirdsLoopSubdivision(MeshCurves=isosurface, Level=1, SmoothNakedEdges=1)
panel = Panel(bnd_2)
preview = CustomPreview(
    Geometry=wbloop,
    Material={diffuse=RGB(221, 160, 221), emission=RGB(66, 48, 66), shine=0.5, specular=RGB(255, 255, 255), transparency=0})
panel_2 = Panel("""Additive 
Manufacturing""")
panel_3 = Panel("""Material
Engineering""")
panel_4 = Panel("""Computational
Design""")
panel_5 = Panel("Nature ")
panel_6 = Panel("""Syntetic
Biology""")
panel_7 = Panel("Design")
panel_8 = Panel("Architecture")
addition = Addition(A=panel_4, B=panel_2)
panel_9 = Panel("""Computational
Design""")
