# Grasshopper definition CurveIntersects.gh (Grasshopper 1.0.7)
# plug-ins: Kangaroo2 Components

# ----
# カーブ全てと選択されたカーブの交点を求める。
# エンドポイントが重なっているだけの場合は無視
number_slider = Slider(2, range=0..5)
crv = Curve([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])
c_script = CSharpScript(crvs=crv, targetIdx=number_slider)  # -> out, A; inputs crvs: list of Curve, targetIdx: Int32
# ---------- c_script: C# usings ----------
using System.Linq;
using Rhino.Geometry.Intersect;
# ---------- c_script: C# ----------
    var target = crvs[targetIdx];
    crvs.RemoveAt(targetIdx);

    A = IntersectCurves(target, crvs);
# ---------- c_script: C# additional code ----------
  private List<Point3d> IntersectCurves(Curve target, List<Curve> others)
  {
    var rtnList = new List<Point3d>();
    for(int i = 0; i < others.Count; i++)
    {
      var intersects = Rhino.Geometry.Intersect.Intersection.CurveCurve(target, others[i], 1, 1);
      foreach(var interEvent in intersects)
      {
        if(interEvent.IsPoint == true)
          rtnList.Add(interEvent.PointA);
      }
    }
    return rtnList;
  }
# ---------- end c_script ----------
c_script_2 = CSharpScript(crvs=crv)  # -> out, A; inputs crvs: list of Curve
# ---------- c_script_2: C# usings ----------
using System.Linq;
# ---------- c_script_2: C# ----------
    var endPts = new List<Point3d>();
    foreach(var crv in crvs)
    {
      endPts.Add(crv.PointAtStart);
      endPts.Add(crv.PointAtEnd);
    }
    
    A = endPts;
# ---------- end c_script_2 ----------
c_script_3 = CSharpScript(crvEnd=c_script_2.A, crvIntersect=c_script.A)  # -> out, A; inputs crvEnd: list of Point3d, crvIntersect: list of Point3d
# ---------- c_script_3: C# ----------
    A = CullContained(crvIntersect, crvEnd);
# ---------- c_script_3: C# additional code ----------
  private List<Point3d> CullContained(List<Point3d> baseList, List<Point3d> cullList)
  {
    var rtnList = baseList.Where(pt => cullList.Contains(pt) == false).ToList();

    return rtnList;
  }
# ---------- end c_script_3 ----------
dot = DotDisplay(Point=c_script_3.A)

crv_2 = Curve(<curve referenced from the Rhino model>)  # disabled
crv_3 = Curve(<curve referenced from the Rhino model>)  # disabled
c_script_4 = CSharpScript(x=crv_3, y=crv_2)  # -> out, A, B, C, D; inputs x: Curve, y: Curve; disabled
# ---------- c_script_4: C# ----------
    var intersecs = Rhino.Geometry.Intersect.Intersection.CurveCurve(x, y, 1, 1);
    A = intersecs[0].PointA;
    B = intersecs[0].PointA2;
    C = intersecs[0].PointB;
    D = intersecs[0].PointB2;
# ---------- end c_script_4 ----------
item = ListItem(List=crv, Index=number_slider, Wrap=True)
panel = Panel([c_script_4.A, c_script_4.B, c_script_4.C, c_script_4.D])  # disabled
move = Move(Geometry=item, Motion=Vector(0, 0, 10))  # -> Geometry, Transform
preview = CustomPreview(Geometry=move.Geometry, Material=ColourSwatch(SwatchColor=RGB(0, 255, 8)))
cull_i = CullIndex(Wrap=True)  # disabled
cull = CullPattern(CullPattern=[False, False, True, True])  # disabled
item_2 = ListItem(Index=0, Wrap=True)  # disabled
fsim = FindSimilarMember()  # -> Hit, Index; disabled
cullpt = CullDuplicates(Tolerance=0.1, CullMode=3)  # -> Points, Indices, Valence; disabled
dcon = DeleteConsecutive(Wrap=False)  # -> Set, Count; disabled
