# Grasshopper definition GH_python1.gh (Grasshopper 1.0.7)

python = GhPythonScript()  # -> out, a
# ---------- python: Python ----------
__author__ = "kazuj"
__version__ = "2019.11.09"

import rhinoscriptsyntax as rs

#Print Hello World
text = "hello world"
print text

a = rs.AddPoint(0,0,0)
# ---------- end python ----------
python_2 = GhPythonScript()  # -> out, a
# ---------- python_2: Python ----------
__author__ = "kazuj"
__version__ = "2019.11.09"

import rhinoscriptsyntax as rs
import random
import math

a = []
for i in range(500):
    x = math.cos(i*0.2) * i*0.1
    y = math.sin(i*0.2) * i*0.08
    if(i<200):
        z = 0
    else:
        z = random.random() * (i-200)* 0.02
    p = rs.AddPoint(x,y,z)
    a.append(p)
# ---------- end python_2 ----------
del = DelaunayMesh(Points=python_2.a, Plane=PlaneXY(0, 0, 0))
